# Grasshopper definition color_palette.gh (Grasshopper 1.0.7)
# plug-ins: Human, LunchBox

panel = Panel("""2
4
6""")
lng = ListLength(List=panel)
item = ListItem(List=panel, Index=0, Wrap=True)  # -> Item, Item1, Item2
swatch = ColourSwatch(SwatchColor=RGB(62, 44, 176))
swatch_2 = ColourSwatch(SwatchColor=RGB(230, 67, 102))
swatch_3 = ColourSwatch(SwatchColor=RGB(209, 224, 40))
series = Series(Start=0, Step="10", Count=lng)
panel_2 = Panel("""2
4
6""")
series_2 = Series(Start=0, Step="10", Count=panel)
item_2 = ListItem(List=panel_2, Index=0, Wrap=True)  # -> Item, Item1, Item2
lng_2 = ListLength(List=panel_2)
range = Range(Domain=Domain(0, 1), Steps="3")

merge = Merge(Data1=swatch_3, Data2=swatch_2, Data3=swatch, Data4=ColourSwatch(SwatchColor=RGB(40, 178, 224)))
avr = Average(Input=merge)
pt = Point(merge)
cir = Circle(Plane=avr, Radius="0.01")
alongcrv = SortAlongCurve(Points=pt, Curve=cir)  # -> Points, Indices
ln = Line(StartPoint=avr, EndPoint=alongcrv.Points)
curvepoint = PointOnCurve(ln, parameter=0.5)
partition = PartitionList(List=curvepoint, Size="2")
avr_2 = Average(Input=partition)  # -> flatten(ArithmeticMean)
col = Colour(avr_2)
merge_2 = Merge(Data1=merge, Data2=col)

range_2 = Range(Domain=Domain(0, 1), Steps=expr("x-1", item.Item1))
merge_3 = Merge(Data1=swatch, Data2=swatch_3, Data3=swatch_2)
series_3 = Series(Start=0, Step="10", Count=lng_2)
number_slider = Slider(4, range=0..10)
merge_4 = Merge(Data1=swatch, Data2=swatch_2)
merge_5 = Merge(Data1=swatch_3, Data2=swatch_2)
split = SplitList(List=range, Index="3")  # -> ListA, ListB
pt_2 = ConstructPoint(XCoordinate=series_2, YCoordinate=graft(series), ZCoordinate=0)
wheel = ColourWheel(
    "3",
    ColourGrips_Style=31,
    ColourGrips_Grip=[5.412033892, 1.223243688, 3.31763879, 5.694215471],
    ColourGrips_Lum=[0.6261246166, 0.7204368999],
    ColourGrips_Range=[0.2791111199, 0.2791111199, 0.2791111199, 0.2791111199],
    ColourGrips_Sat=[0.6762189033, 0.8913823798])
series_4 = Series(Start=0, Step="10", Count=panel_2)
interp = InterpolateData(Data=merge_5, Parameter=range_2, Interpolation=2)
number_slider_2 = Slider(0.8, range=0..1)

argb = SplitARGB(Colour=merge_3)  # -> Alpha, Red, Green, Blue
merge_6 = Merge(Data1=graft(argb.Red), Data2=graft(argb.Green), Data3=graft(argb.Blue))
addition = Addition(A=merge_6, B=number_slider_2)
mod = Modulus(A=addition, B=1)
item_3 = ListItem(List=mod, Index=0, Wrap=True)  # -> Item, Item1, Item2
frgb = ColourRGBF(Alpha=1, Red=item_3.Item, Green=item_3.Item1, Blue=item_3.Item2)  # -> flatten(Colour)

addition_2 = Addition(A=split.ListA, B=Slider(0.001, range=0.001..0.17))
mod_2 = Modulus(A=addition_2, B=1)
number_slider_3 = Slider(4, range=0..10)

ahsl = SplitAHSL(Colour=merge_3)  # -> Alpha, Hue, Saturation, Luminance
addition_3 = Addition(A=ahsl.Hue, B=number_slider_2)
hsl = ColourHSL(Alpha=1, Hue=addition_3, Saturation=ahsl.Saturation, Luminance=ahsl.Luminance)

dom = ConstructDomain(DomainStart=expr("-x/2", number_slider), DomainEnd=expr("x/2", number_slider))
pt_3 = ConstructPoint(XCoordinate=series_4, YCoordinate=graft(series_3), ZCoordinate=0)
hsl_2 = ColourHSL(Alpha=1, Hue=mod_2, Saturation=Slider(1, range=0.001..1), Luminance=Slider(0.678, range=0.001..1))
pt_4 = Point(hsl_2)
rectangle = Rectangle(Plane=pt_2, XSize=dom, YSize=dom, Radius=0)  # -> Rectangle, Length
dom_2 = ConstructDomain(DomainStart=expr("-x/2", number_slider_3), DomainEnd=expr("x/2", number_slider_3))

ahsl_2 = SplitAHSL(Colour=pt_4)  # -> Alpha, Hue, Saturation, Luminance
addition_4 = Addition(A=ahsl_2.Hue, B=Slider(0.17, range=0..1))
hsl_3 = ColourHSL(Alpha=1, Hue=addition_4, Saturation=ahsl_2.Saturation, Luminance=ahsl_2.Luminance)

rectangle_2 = Rectangle(Plane=pt_3, XSize=dom_2, YSize=dom_2, Radius=0)  # -> Rectangle, Length
shift = ShiftList(List=pt_4, Shift=Slider(1, range=0..2), Wrap=True)
item_4 = ListItem(List=shift, Index=0, Wrap=True)  # -> Item, Item1
split_2 = SplitList(List=shift, Index="2")  # -> ListA, ListB
merge_7 = Merge(Data1=merge_3, Data2=reverse(hsl))
range_3 = Range(Domain=Domain(0, 1), Steps=expr("x-1", "4"))
merge_8 = Merge(Data1=item_4.Item1, Data2=split_2.ListB)  # -> flatten(Result)
interp_2 = InterpolateData(Data=split_2.ListA, Parameter=range_3, Interpolation=2)
entwine = Entwine(Branch00=merge_4, Branch01=interp, Branch02=merge_7, FlattenInputs=True)
txt = Text(entwine)
merge_9 = Merge(Data1=pt_4, Data2=reverse(hsl_3))
panel_3 = Panel("3")
entwine_2 = Entwine(Branch00=merge_8, Branch01=interp_2, Branch02=merge_9, FlattenInputs=True)
previewlw = CustomPreviewLineweights(Geometry=rectangle.Rectangle, Shader=entwine, Thickness=number_slider, Absolute=invert(False))

panel_5 = Panel("""gender
age
group""")
datatable = CreateDataTable(TableName="colors", TableHeaders=panel_5, ValueTree=entwine_2)
dataset = CreateDataSet(DataSetName="colors", DataTables=datatable)
path = FilePath("C:\Users\nerii\Desktop\Work\Noumena\NEX-UI\Nex_viz\styles\")
concat = Concatenate(FragmentA=path, FragmentB="colors_viz.json")
json = CreateJSON(WriteJSON=Button(), FilePath=concat, DataSet=dataset)

previewlw_2 = CustomPreviewLineweights(Geometry=rectangle_2.Rectangle, Shader=entwine_2, Thickness=number_slider_3, Absolute=invert(False))
vb = VBScript(rgb=txt)  # -> out, hex; inputs rgb: Color
# ---------- vb: VB ----------
    'First recreate the colour from scratch to remove any naming associations.
    Dim col As Color = Color.FromARGB(rgb.R, rgb.G, rgb.B)
    hex = System.Drawing.ColorTranslator.ToHtml(col)
# ---------- end vb ----------

bang = ExplodeTree(Data=vb.hex)  # -> Branch0, Branch1, Branch2
datatable_2 = CreateDataTable(TableName="gender", TableHeaders="HEX", ValueTree=simplify(bang.Branch0))
datatable_3 = CreateDataTable(TableName="age", TableHeaders="HEX", ValueTree=simplify(bang.Branch1))
datatable_4 = CreateDataTable(TableName="group", TableHeaders="HEX", ValueTree=simplify(bang.Branch2))
merge_10 = Merge(Data1=datatable_2, Data2=datatable_3, Data3=datatable_4)  # -> flatten(Result)
dataset_2 = CreateDataSet(DataSetName="data", DataTables=merge_10)
path_2 = FilePath("C:\Users\nerii\Desktop\Work\Noumena\NEX-UI\Nex_viz\styles\")
concat_2 = Concatenate(FragmentA=path_2, FragmentB="colors_viz.json")
json_2 = CreateJSON(WriteJSON=Button(), FilePath=concat_2, DataSet=dataset_2)
