# Grasshopper definition mesh-grid.gh (Grasshopper 1.0.7)
# plug-ins: Tarsier, LunchBox

srf = Surface(<surface referenced from the Rhino model>)
srf_2 = Surface(<surface referenced from the Rhino model>)
crv = Curve([<curve referenced from the Rhino model> x15])
trim = TrimWithRegion(Curve=crv, Region=srf_2)  # -> flatten(Inside), Outside
crv_2 = Curve(trim.Inside)
rec = Rectangle(srf_2)
explode = Explode(Curve=rec, Recursive=True)  # -> Segments, Vertices
len = Length(Curve=explode.Segments)

# ---- group: path and start
lng = ListLength(List=crv_2)
dom = ConstructDomain(DomainStart=Slider(0.2, range=0..1), DomainEnd=Slider(0.3, range=0..1))
len_2 = Length(Curve=crv_2)
random = Random(Range=dom, Number=lng, Seed=2)
division = Division(A=len_2, B=random)
ma = MassAddition(Input=division)  # -> Result, PartialResults
multiplication = Multiplication(A=ma.Result, B=Slider(0.66, range=0..1))
popgeo = PopulateGeometry(Geometry=crv_2, Count=division, Seed=1)
random_2 = Random(Range=multiplication, Number=lng, Seed=2)
alongcrv = SortAlongCurve(Points=popgeo, Curve=graft(crv_2))  # -> simplify(Points), Indices
int = Integer(graft(random_2))

# ---- group: Profile
crv_3 = Curve(crv_2)
lng_2 = ListLength(List=crv_3)
repeat = RepeatData(Data="3", Length=lng_2)
series = Series(Start=0, Step=1, Count=lng_2)
panel = Panel("""0
1""")
panel_2 = Panel("""0
1
2
3""")
panel_3 = Panel("""0
1
2
3
4
5""")
random_3 = Random(Range="6", Number=repeat, Seed=series)  # -> simplify(Random)
item = ListItem(List=random_3, Index=0, Wrap=True)  # -> Item, Item1, Item2
item_2 = ListItem(List=panel, Index=item.Item, Wrap=True)
item_3 = ListItem(List=panel_2, Index=item.Item1, Wrap=True)
item_4 = ListItem(List=panel_3, Index=item.Item2, Wrap=True)
merge = Merge(Data1=item_2, Data2=item_3, Data3=item_4)

# ----
division_2 = Division(A=len, B=Slider(0.25, range=0..1))
round = Round(Number=division_2)  # -> Nearest, Floor, Ceiling
panel_4 = Panel("""M
F""")
panel_5 = Panel("""1
2
3
4""")
panel_6 = Panel("""CA
IN
AS
ME
AF
OT""")
item_5 = ListItem(List=round.Nearest, Index=0, Wrap=True)  # -> Item, Item1, Item2
merge_2 = Merge(Data1=item_5.Item, Data2=item_5.Item1)
mplane = MeshPlane(Boundary=srf_2, WidthCount=item_5.Item, HeightCount=item_5.Item1)  # -> Mesh, Area
faceb = FaceBoundaries(Mesh=mplane.Mesh)
tstat = TreeStatistics(Tree=popgeo)  # -> Paths, Length, Count
range = Range(Domain=Domain(0, 0.5), Steps=expr("x-1", tstat.Count))
lng_3 = ListLength(List=popgeo)
join = TextJoin(Text=merge, Join=";")  # -> flatten(Result)
pt = Point(simplify(alongcrv.Points))
area = Area(Geometry=faceb)  # -> Area, Centroid
addition = Addition(A=int, B=graft(range))
series_2 = Series(Start=addition, Step=1, Count=lng_3)  # -> simplify(Series)
repeat_2 = RepeatData(Data=graft(join), Length=lng_3)  # -> simplify(Data)
cp = ClosestPoint(Point=pt, Cloud=area.Centroid)  # -> ClosestPoint, simplify(CPIndex), Distance
brep = Brep([<brep referenced from the Rhino model> x6])
brep_2 = Brep([<brep referenced from the Rhino model> x39])
sort = SortList(Keys=flatten(series_2), ValuesA=flatten(cp.CPIndex), ValuesB=flatten(repeat_2))  # -> Keys, ValuesA, ValuesB
number_slider = Slider(50000, range=0..1000000)
number_slider_2 = Slider(30000, range=0..1000000)
mesh = MeshBrep(
    Brep=brep_2,
    Settings={GridMaxCount=0, GridMinCount=16, JaggedSeams=False, MaxEdgeLength=0, MinEdgeLength=0.0001, MinTolerance=0, Refine=True, RefineAngle=0, RelativeTolerance=0.65, SimplePlanes=True, Tolerance=0})
mesh_2 = MeshBrep(
    Brep=brep,
    Settings={GridMaxCount=0, GridMinCount=16, JaggedSeams=False, MaxEdgeLength=0, MinEdgeLength=0.0001, MinTolerance=0, Refine=True, RefineAngle=0, RelativeTolerance=0.65, SimplePlanes=True, Tolerance=0})
round_2 = Round(Number=sort.Keys)  # -> Nearest, Floor, Ceiling
mjoin = MeshJoin(Meshes=mesh)
mjoin_2 = MeshJoin(Meshes=mesh_2)
popmesh = PopulateMesh(Mesh=mjoin, Amount=number_slider, Normals=False, Seed=2)
popmesh_2 = PopulateMesh(Mesh=mjoin_2, Amount=number_slider_2, Normals=False, Seed=2)

panel_7 = Panel(";")
panel_8 = Panel("""X
Y""")
join_2 = TextJoin(Text=merge_2, Join=panel_7)
join_3 = TextJoin(Text=panel_8, Join=panel_7)
merge_3 = Merge(Data1=join_3, Data2=join_2)  # -> flatten(Result)
panel_9 = Panel(merge_3)

data = Data(flatten(sort.ValuesB))
panel_10 = Panel(";")
split = TextSplit(Text=data, Separators=panel_10)  # -> simplify(Result)
merge_4 = Merge(Data1=graft(round_2.Floor), Data2=graft(sort.ValuesA))  # -> simplify(Result)
data_2 = Data(split)
ins = InsertItems(List=data_2, Item=merge_4, Indices="0", Wrap=True)
flip = FlipMatrix(Data=ins)
panel_11 = Panel("""timestamp
id
gender
age
group""")
datatable = CreateDataTable(TableName="data", TableHeaders=panel_11, ValueTree=simplify(flip))  # -> flatten(DataTable)
path = FilePath("C:\Users\nerii\Desktop\Work\Noumena\NEX-UI\Nex_viz\models\json\")
concat = Concatenate(FragmentA=path, FragmentB="grid_values.json")
dataset = CreateDataSet(DataSetName="data", DataTables=datatable)
path_2 = FilePath(concat)
json = CreateJSON(WriteJSON=Button(), FilePath=path_2, DataSet=dataset)

geo = Geometry([<brep referenced from the Rhino model> x2, <curve referenced from the Rhino model>])
pt_2 = Point(area.Centroid)
pdecon = Deconstruct(Point=pt_2)  # -> XComponent, YComponent, ZComponent
pull = PullPoint(Point=pt_2, Geometry=geo, ClosestOnly=False)  # -> ClosestPoint, Distance
index = ItemIndex(List=pt_2, Item=pt_2)
item_6 = ListItem(List=pull.Distance, Index=0, Wrap=True)  # -> flatten(Item), flatten(Item1), flatten(Item2)
concat_2 = Concatenate(
    FragmentD=index,
    FragmentA=pdecon.XComponent,
    FragmentB=pdecon.ZComponent,
    FragmentC=pdecon.YComponent,
    FragmentE=item_6.Item,
    FragmentF=item_6.Item1,
    FragmentG=item_6.Item2,
    JoinSeparator=";")
merge_5 = Merge(Data1="id;X;Y;Z;dist1;dist2;dist3", Data2=concat_2)  # -> flatten(Result)
panel_12 = Panel(merge_5)

swatch = ColourSwatch(SwatchColor=RGB(204, 200, 200))
swatch_2 = ColourSwatch(SwatchColor=RGB(255, 255, 255))
deconstruct = DeconstructPointCloud(PointCloud=popmesh)  # -> Points, Colours, Normals
deconstruct_2 = DeconstructPointCloud(PointCloud=popmesh_2)  # -> Points, Colours, Normals
repeat_3 = RepeatData(Data=swatch, Length=number_slider)
repeat_4 = RepeatData(Data=swatch, Length=number_slider_2)
construct = ConstructPointCloud(Points=deconstruct.Points, Colours=repeat_3)
number_slider_3 = Slider(0.5, range=0..1)
construct_2 = ConstructPointCloud(Points=deconstruct_2.Points, Colours=repeat_4)
preview = PreviewPointCloud(PointCloud=construct_2, Weight=number_slider_3)
preview_2 = PreviewPointCloud(PointCloud=construct, Weight=number_slider_3)
merge_6 = Merge()

merge_7 = MergePointClouds(PointClouds=[construct, construct_2])
deconstruct_3 = DeconstructPointCloud(PointCloud=merge_7)  # -> Points, Colours, Normals
pdecon_2 = Deconstruct(Point=deconstruct_3.Points)  # -> XComponent, YComponent, ZComponent
concat_3 = Concatenate(FragmentA=pdecon_2.XComponent, FragmentB=pdecon_2.ZComponent, FragmentC=pdecon_2.YComponent, JoinSeparator=";")
merge_8 = Merge(Data1="X;Y;Z", Data2=concat_3)  # -> flatten(Result)
panel_13 = Panel(merge_8)
